# Grasshopper definition Textmining.gh (Grasshopper 0.9.76)
# plug-ins: Python Interpreter, Human UI, Human

getscreen = GetScreenDimensions()  # -> Width, Height
multiplication = Multiplication(A=getscreen.Width, B=0.3333333333)
multiplication_2 = Multiplication(A=getscreen.Height, B=0.8)
launchwin = LaunchWindow(
    Show=Toggle(True),
    Name="Text Mining parameters",
    Width=multiplication,
    Height=multiplication_2,
    ChildStatus=0,
    EnableHorizScroll=False)
filepicker = CreateFilePicker(ButtonLabelText="Find XML file", DialogType=0, MustExist=True, Filter="All Files|*.*")
true_button = CreateTrueOnlyButton(ButtonName="Load XML file", ButtonStyle=0)
entwine = Entwine(Branch00=filepicker, Branch01=true_button, FlattenInputs=True)
values = ValueListener(Elements=true_button, SomeProperty=True)  # -> Values, Indices
values_2 = ValueListener(Elements=filepicker, SomeProperty=True)  # -> Values, Indices

# ---- group: Update Excel extract/write
toggle = BooleanToggle(True)

# ----
item = ListItem(List=values_2.Values, Index=0, Wrap=True)
toggle_2 = BooleanToggle(False)
panel = Panel("C:\Users\adao\Desktop\Responses\Responses")
toggle_3 = BooleanToggle(False)
xl_path = XLFilePath(Filepath=values_2.Values, Sheet="Sheet1", Stream=values.Values)  # -> out, P
# ---------- xl_path: VB ----------
    Component.Params.Input(0).Name = "File Path"
    Component.Params.Input(0).Description = "Optional Path specifying the location of the excel file. If blank, C:\Users\Public\Documents will be supplimented"
    Component.Params.Input(1).Name = "Workbook Name"
    Component.Params.Input(1).Description = "Optional text input for the name of the workbook. If no workbook is specified, uses the active Workbook, if workbook is specified and exists uses existing workbook. If workbook Is specified And does Not exist creates a New workbook And saves it To current grasshopper filepath location."
    Component.Params.Input(2).Name = "Worksheet Name"
    Component.Params.Input(2).Description = "Optional text input for the name of the worksheet. If no sheet is specified, uses active sheet, if sheet is specified and exists uses existing sheet. If sheet Is specified And does Not exist creates a New sheet"
    Component.Params.Input(3).Name = "_Activate"
    Component.Params.Input(3).Description = "If true, sets the specified workbook and worksheet to active"

    Component.Params.Output(1).Name = "Path Parameters"
    Component.Params.Output(1).Description = "A formatted list of path parameters"
    If _Stream = True Then
      Dim arrOut As New list(Of Object)

      Dim oldCI As System.Globalization.CultureInfo = system.Threading.Thread.CurrentThread.CurrentCulture
      System.Threading.Thread.CurrentThread.CurrentCulture = New System.Globalization.CultureInfo("en-US")

      'Access Active Session of Excel
      Dim objExcel As Object
      objExcel = System.Runtime.InteropServices.Marshal.GetActiveObject("Excel.Application")

      objExcel.screenUpdating = False

      'Access Workbook: If no workbook is specified, uses the active Workbook, if workbook is specified and exists uses existing workbook,
      'If workbook Is specified And does Not exist creates a New workbook And saves it To current grasshopper filepath location,
      'If grasshopper has Not been saved, saves to desktop
      Dim excelWorkbook As Object
      If Workbook <> Nothing Then

        Dim oWorkbook As Object
        Dim bookBool As Boolean
        Dim bookPath As String

        if ubound(split(Workbook, ".")) = 0 then Workbook = Workbook & ".xlsx"
        For Each oWorkbook In objExcel.workbooks

          If oWorkbook.Name = Workbook Then

            bookBool = True
            Exit For

          End If
        Next oWorkbook

        If bookBool = True Then
          excelWorkbook = objExcel.Workbooks(Workbook).Activate
        Else
          If FilePath <> Nothing Then
            bookPath = FilePath
          Else
            If Owner.OnPingDocument().FilePath = Nothing Then
              bookPath = "C:\Users\Public\Documents"
            Else
              bookPath = Path.GetDirectoryName(Owner.OnPingDocument().FilePath)
            End If
          End If

          If System.IO.File.Exists(CStr(bookPath & "/" & CStr(Workbook))) Then
            objExcel.Workbooks.open(CStr(bookPath & "/" & CStr(Workbook)))
          Else
            objExcel.Workbooks.add
            objExcel.activeWorkbook.SaveAs(bookPath & "/" & CStr(Workbook))

          End If

        End If
      End If
      excelWorkbook = objExcel.activeWorkbook

      'Access Sheet: If no sheet is specified, uses active sheet, if sheet is specified and exists uses existing sheet,
      'If sheet Is specified And does Not exist creates a New sheet
      Dim excelSheet As Object
      If sheet = Nothing Then
        excelSheet = objExcel.ActiveSheet
      Else
        Dim oSheet As Object
        Dim shtBool As Boolean

        For Each oSheet In excelWorkbook.Sheets

          If oSheet.Name = Sheet Then

            shtBool = True
            Exit For

          End If

        Next oSheet

        If shtBool = False Then
          excelWorkbook.WorkSheets.add().name = Sheet
        End If
        excelSheet = objExcel.Sheets(Sheet)
      End If

      arrOut.add(objExcel)
      arrOut.add(excelWorkbook)
      arrOut.add(excelSheet)

      excelSheet.activate
      objExcel.screenUpdating = True
      P = arrOut
    End If
# ---------- end xl_path ----------
# Extracts Topic Dictionary
xl_path_2 = XLFilePath(Filepath=panel, Sheet="Topic_dictionary", Stream=toggle)  # -> out, P; same code as xl_path
# Writes topic count
xl_path_3 = XLFilePath(Filepath=panel, Sheet="TopicResults", Stream=toggle)  # -> out, P; same code as xl_path
xl_data_in_basic = XLDataIn(XL_Path=xl_path.P, ByColumn=toggle_3, Type=0, Stream=values.Values)  # -> out, A, B, Data; inputs XL_Path: list, Origin: Point3d, Bound: Point3d
# ---------- xl_data_in_basic: VB ----------
    Component.Params.Input(0).Name = "Path"
    Component.Params.Input(0).Description = "Optional input for the XL Path component which specifies the Target Workbook and Sheet. If blank the active workbook and worksheet is used, or the worksheet index supplied by an origin component"
    Component.Params.Input(1).Name = "Data Origin"
    Component.Params.Input(1).Description = "Optional point input which specifies the lower bounds from which data will be read where X = Row, Y = Column, and Z = Sheet Index. If Z = 0 the active sheet will be used. If input is empty first used cell on active sheet will be used"
    Component.Params.Input(2).Name = "Data Bound"
    Component.Params.Input(2).Description = "Optional point input which specifies the upper bounds from which data will be read where X = Row, Y = Column, and Z = Sheet Index. If Z = 0 the active sheet will be used, If input is empty last used cell on active sheet will be used"
    Component.Params.Input(3).Name = "By Column"
    Component.Params.Input(3).Description = "Sets if data will be transposed"
    Component.Params.Input(4).Name = "Type"
    Component.Params.Input(4).Description = "Optional input for the XL Data Type component or integer value specifying the type of data being read [Value = 0, Value2 = 1, Formula = 2, FormulaLocal = 3, FormulaR1C1 = 4, FormulaR1C1Local = 5]"
    Component.Params.Input(5).Name = "Stream"
    Component.Params.Input(5).Description = "If true, data will be read"

    Component.Params.Output(1).Name = "Origin"
    Component.Params.Output(1).Description = "List output of points which specify the lower bounds of read data"
    Component.Params.Output(2).Name = "Bound"
    Component.Params.Output(2).Description = "List output of points which specify the upper bounds of read data"
    Component.Params.Output(3).Name = "Data"
    Component.Params.Output(3).Description = "Datatree of generic data read from Excel"
    If _Stream = True Then
      'If _LIVE = True Then owner.ExpireSolution(True)

      Dim objExcel, excelWorkbook, excelSheet As Object

      If XL_Path.Count() > 1 Then
        objExcel = XL_Path.item(0)
        excelWorkbook = XL_Path.item(1)
        excelSheet = XL_Path.item(2)
      Else
        Dim oldCI As System.Globalization.CultureInfo = system.Threading.Thread.CurrentThread.CurrentCulture
        System.Threading.Thread.CurrentThread.CurrentCulture = New System.Globalization.CultureInfo("en-US")

        'Access Active Session of Excel if no Path is specified

        objExcel = System.Runtime.InteropServices.Marshal.GetActiveObject("Excel.Application")
        excelWorkbook = objExcel.activeWorkbook
        excelSheet = objExcel.ActiveSheet
      End If

      objExcel.screenUpdating = False

      Dim arrStr As New datatree(Of Object)
      Dim i,j,k,m,n As Integer

      If XL_Path.count() <= 1 Then
        If CInt(origin.z) = 0 Then
          n = 0
          excelSheet = objExcel.ActiveSheet
        ElseIf CInt(bound.z) = 0 Then
          n = 0
          excelSheet = excelWorkbook.Sheets.item(CInt(origin.Z))
        Else
          n = (bound.z - origin.z)
          excelSheet = excelWorkbook.Sheets.item(CInt(origin.Z))
        End If
      End If

      'specify a range in excel and stream data
      For m = 0 To n Step 1
        If m <> 0 Then
          excelSheet = excelWorkbook.Sheets.item(CInt(origin.Z + n))
        End If

        If Origin = Nothing Then
          Origin.Y = excelSheet.usedrange.row
          Origin.X = excelSheet.usedrange.column
        End If
        If Bound = Nothing Then
          Bound.Y = excelSheet.usedrange.rows(excelSheet.usedrange.rows.count).row
          Bound.X = excelSheet.usedrange.columns(excelSheet.usedrange.columns.count).column
        End If
        Dim rng As Object
        If (origin.x = bound.x) And (origin.y = bound.y) Then
          arrStr.add(excelSheet.Cells(Origin.Y, Origin.X).value, New GH_Path(0))
        Else

          If type = 1 Then
            rng = excelSheet.Range(excelSheet.Cells(Origin.Y, Origin.X), excelSheet.Cells(Bound.Y, Bound.X)).value2
          ElseIf type = 2 Then
            rng = excelSheet.Range(excelSheet.Cells(Origin.Y, Origin.X), excelSheet.Cells(Bound.Y, Bound.X)).formula
          ElseIf type = 3 Then
            rng = excelSheet.Range(excelSheet.Cells(Origin.Y, Origin.X), excelSheet.Cells(Bound.Y, Bound.X)).formulalocal
          ElseIf type = 4 Then
            rng = excelSheet.Range(excelSheet.Cells(Origin.Y, Origin.X), excelSheet.Cells(Bound.Y, Bound.X)).FormulaR1C1
          ElseIf type = 5 Then
            rng = excelSheet.Range(excelSheet.Cells(Origin.Y, Origin.X), excelSheet.Cells(Bound.Y, Bound.X)).FormulaR1C1Local
          Else
            rng = excelSheet.Range(excelSheet.Cells(Origin.Y, Origin.X), excelSheet.Cells(Bound.Y, Bound.X)).value
          End If

          If ByColumn = True Then
            rng = objExcel.transpose(rng)
          End If
          k = 0
          For i = LBound(rng, 1) To UBound(rng, 1) Step 1
            For j = LBound(rng, 2) To UBound(rng, 2) Step 1
              If n = 0 Then
                arrStr.add(rng(i, j), New GH_Path(k))
              Else
                arrStr.add(rng(i, j), New GH_Path({m,k}))
              End If
            Next
          k = k + 1
          Next
        End If
      Next
      excelSheet.activate
      objExcel.screenUpdating = True

      A = New point3d(Origin.x, origin.Y, excelSheet.Index)
      B = New point3d(Bound.x, Bound.Y, excelSheet.Index)
      Data = arrStr

    End If
# ---------- end xl_data_in_basic ----------
# Associative Results
xl_path_4 = XLFilePath(Filepath=panel, Sheet="AssociativeResults", Stream=values.Values)  # -> out, P; same code as xl_path
xl_data_in_basic_2 = XLDataIn(XL_Path=xl_path_2.P, ByColumn=toggle_3, Type=0, Stream=toggle)  # -> out, A, B, Data; inputs XL_Path: list, Origin: Point3d, Bound: Point3d; same code as xl_data_in_basic
panel_2 = Panel(xl_data_in_basic.Data)
split = SplitList(List=xl_data_in_basic_2.Data, Index=1)  # -> ListA, ListB
flatten = FlattenTree(Tree=split.ListA, Path="{0}")
lng = ListLength(List=panel_2)
flatten_2 = FlattenTree(Tree=panel_2, Path="{0}")
item_2 = TreeItem(Tree=lng, Path="{0}", Index="1", Wrap=True)
lng_2 = ListLength(List=flatten_2)
division = Division(A=lng_2, B=item_2)
concat = Concatenate(FragmentA="0.0 to ", FragmentB=lng_2)
series = Series(Start=item_2, Step=item_2, Count=division)
range = Range(Domain=concat, Steps=lng_2)
top_words = Slider(10, range=1..15)
cull_i = CullIndex(List=range, Indices=series, Wrap=True)
cull_i_2 = CullIndex(List=flatten_2, Indices=cull_i, Wrap=True)
panel_3 = Panel(cull_i_2)
slider = CreateSlider(Slider=top_words, ShowBounds=False, ShowTicks=False, ShowTooltip=False, ShowValLabel=True)
data = Data(cull_i_2)
values_3 = ValueListener(Elements=slider, SomeProperty=True)  # -> Values, Indices
nullrep = ReplaceNulls(Items=panel_3, Replacements="Null")  # -> Items, Count
punctuation_splitter = Panel(""" 
.
,
/
"
(
)
'
-
!
:""")
label = CreateLabel(LabelText="There are no monkeys.", LabelSize=12, Justification=0)
# Divide each sentence in
# tokenized (seperate) words
graft = GraftTree(Tree=nullrep.Items, IncludeEmptyLists=True, IncludeNullItems=True)
textbox = CreateTextBox(Label="Top words", DefaultText="Word", UpdateButton=True)
format = Format(Format="Top {0} words", Culture=127, Data0=values_3.Values)
common_words_with_no_value = Panel("""the
of
and
to
a
in
i
for
is
as
it
be
are
that
on
with
but
or
at
so
which
can
they
t
from
some
s
by
this
would""")
tb = CreateTextBlock(Text="Top words", TextSize=12, Justification=0)
tb_2 = CreateTextBlock(Text="Top words", TextSize=12, Justification=0)
python = PythonScript(text=nullrep.Items, Punctuation=punctuation_splitter)  # -> out, Tokens, endtext; inputs Punctuation: list
# ---------- python: Python ----------
spacelocation = []

number_of_spaces = 0

endtext = len(text)

text = text.lower()

for index, splitter in enumerate(text):
    if splitter in Punctuation:
        number_of_spaces = number_of_spaces +1
        spacelocation.append(index)

spacelocation.insert(0, 0)
spacelocation.insert(number_of_spaces+1, endtext)

end = number_of_spaces

Tokens = ["none"]#*number_of_spaces

def wordtokenization(i):
    a = spacelocation[i] +1
    j = i +1
    b = spacelocation[j]
    if a-b!= 0:
        word = text[a:b]
        Tokens.insert(i ,word)
    #print word

i = 1

while i < number_of_spaces:
    wordtokenization(i)
    i = i+1

startsentence = spacelocation[1]

startword = text[0:startsentence]

Tokens[0] = startword

endwordstart = spacelocation[number_of_spaces] +1

Tokens.append(text[endwordstart:endtext])
#Tokens[end] = text[endwordstart:endtext]
# ---------- end python ----------
setlabel = SetLabelContents(LabelToModify=label, NewLabelContents=format)
cset = CreateSet(List=flatten(python.Tokens))  # -> Set, Map
# Count occurence of
# words in all survey
python_2 = PythonScript(text=flatten(python.Tokens), list_of_words=cset.Set, useless_words=common_words_with_no_value)  # -> out, wordcount; inputs text: list, list_of_words: list, useless_words: list
# ---------- python_2: Python ----------
wordcount = [] 

for item in list_of_words:
    if item in useless_words:
        count = 0
    else:
        count = text.count(item)
    wordcount.append(count)
# ---------- end python_2 ----------
random = Random(Range=Domain(0, 1), Number=values_3.Values, Seed=2)
sort = SortList(Keys=python_2.wordcount, ValuesA=cset.Set)  # -> Keys, ValuesA
top_categories = Slider(3, range=1..30)
panel_4 = Panel(random)
rev = ReverseList(List=sort.Keys)
rev_2 = ReverseList(List=sort.ValuesA)
split_2 = SplitList(List=rev_2, Index=1)  # -> ListA, ListB
split_3 = SplitList(List=split_2.ListB, Index=values_3.Values)  # -> ListA, ListB
split_4 = SplitList(List=rev, Index=1)  # -> ListA, ListB
split_5 = SplitList(List=split_4.ListB, Index=values_3.Values)  # -> ListA, ListB
graft_2 = GraftTree(Tree=split_3.ListA, IncludeEmptyLists=True, IncludeNullItems=True)
slider_2 = CreateSlider(Slider=top_categories, ShowBounds=False, ShowTicks=False, ShowTooltip=False, ShowValLabel=True)
python_3 = PythonScript(count_list=split_4.ListB)  # -> out, y_position; inputs count_list: list
# ---------- python_3: Python ----------
y_position = [0]

y = 0

for weight in count_list:
    y = weight + y
    y_position.append(y)
# ---------- end python_3 ----------
graft_3 = GraftTree(Tree=split_5.ListA, IncludeEmptyLists=True, IncludeNullItems=True)
# Topic count
count_elements_from_one_list_in_another = PythonScript(Comments=python.Tokens, Topics=split.ListB)  # -> out, Topic_count, Word_found, paths; inputs Comments: tree, Topics: tree
# ---------- count_elements_from_one_list_in_another: Python ----------
import rhinoscriptsyntax as rs
import clr
clr.AddReference("Grasshopper")
from Grasshopper.Kernel.Data import GH_Path as ghpath
from Grasshopper import DataTree
import System


Word_found = DataTree[System.Object]()

Topic_count = DataTree[System.Object]()

paths = DataTree[System.Object]()

i = -1

for topiclist in Topics.Branches:
    while "" in topiclist:
        topiclist.remove("")
    i = i+1
    path = ghpath(0,i)
    
    count = 0
    path_index = -1
    for comment in Comments.Branches:
        wordfound = 0
        path_index = path_index +1
        for word in comment:
            #print wordfound
            if wordfound == 0:
                if word in topiclist:
                    Word_found.Add(word,path)
                    wordfound = 1
                    count = count + 1
                    pathindex = "{0;0;0;0;" + str(path_index) + "}"
                    paths.Add(pathindex,path)
    Topic_count.Add(count,path)
# ---------- end count_elements_from_one_list_in_another ----------
# Word association
python_4 = PythonScript(text=flatten(python.Tokens), key_words=graft_2, list_of_words=split_2.ListB, useless_words=common_words_with_no_value)  # -> out, word_before, word_after, wbcount, wacount; inputs text: list, key_words: list, list_of_words: list, useless_words: list
# ---------- python_4: Python ----------
word_before = []
word_after = []

for keyword in key_words:
    for index, word in enumerate(text):
        if index >= 1 and index < len(text):
            if keyword == word:
                i = index - 1
                j = index +1
                if text[i] not in useless_words:
                    word_before.append(text[i])
                if text[j] not in useless_words:
                    word_after.append(text[j])

def wordcount(text, wordcount):
    for item in list_of_words:
        count = text.count(item)
        wordcount.append(count)

wbcount  = []

#for item in list_of_words:
#    count = word_before.count(item)
#    wbcount.append(count)

wacount = []

#for item in list_of_words:
#        count = word_after.count(item)
#    wacount.append(count)
#    
wordcount(word_before, wbcount)

wordcount(word_after, wacount)
# ---------- end python_4 ----------
tb_3 = CreateTextBlock(Text="word", TextSize=12, Justification=0)
list = ItemSelector(
    split.ListA,
    {"Accommodation", "Accessibility", "Architecture / Look and Feel", "Campus Connectivity", "Cleanliness", "Collaboration", "Common Spaces", "Community", "Connection to City", "Demolition", "New Facilities", "Fit for Purpuse", "IT Provision", "Landscaping/green space", "Masterplan Strategy", "More Space", "IEQ", "Layout", "Operational aspects", "Parking and Cycling Spaces", "Refurbish", "Research Facilities", "Rundown Buildings", "Space Utilisation", "Study Spaces", "Sustainability", "Teaching Facilities", "User Experience", "Utilisation"}, selected="Accommodation")
tb_4 = CreateTextBlock(Text="word", TextSize=12, Justification=0)
tb_5 = CreateTextBlock(Text="word", TextSize=12, Justification=0)
tb_6 = CreateTextBlock(Text="word", TextSize=12, Justification=0)
tb_7 = CreateTextBlock(Text="word", TextSize=12, Justification=0)
tb_8 = CreateTextBlock(Text="word", TextSize=12, Justification=0)
tb_9 = CreateTextBlock(Text="word", TextSize=12, Justification=0)
tb_10 = CreateTextBlock(Text=" ", TextSize=12, Justification=0)
tb_11 = CreateTextBlock(Text=" ", TextSize=12, Justification=0)
tb_12 = CreateTextBlock(Text="word", TextSize=12, Justification=0)
tb_13 = CreateTextBlock(Text=" ", TextSize=12, Justification=0)
tb_14 = CreateTextBlock(Text=" ", TextSize=12, Justification=0)
tb_15 = CreateTextBlock(Text="word", TextSize=12, Justification=0)
tb_16 = CreateTextBlock(Text="word", TextSize=12, Justification=0)
tb_17 = CreateTextBlock(Text=" ", TextSize=12, Justification=0)
values_4 = ValueListener(Elements=slider_2, SomeProperty=True)  # -> Values, Indices
pt = ConstructPoint(XCoordinate=0, YCoordinate=python_3.y_position, ZCoordinate=0)
xy = XYPlane(Origin=pt)
panel_5 = Panel(split.ListB)
number_slider = Slider(468, range=0..1000)

# ---- group: Transfer to Excel
sort_2 = SortList(Keys=flatten(count_elements_from_one_list_in_another.Topic_count), ValuesA=flatten(split.ListA))  # -> Keys, ValuesA
rev_3 = ReverseList(List=sort_2.ValuesA)
rev_4 = ReverseList(List=sort_2.Keys)
entwine_2 = Entwine(Branch00=rev_3, Branch01=rev_4, FlattenInputs=True)
xl_data_out = XLDataOut(XL_Path=xl_path_3.P, Data=entwine_2, ByColumn=Toggle(True), Stream=Toggle(True))  # -> out, A, B; inputs XL_Path: list, Origin: list of Point3d, Data: tree, XL_Fill: tree, XL_Line: tree, XL_Font: tree
# ---------- xl_data_out: VB ----------
    Component.Params.Input(0).Name = "Path"
    Component.Params.Input(0).Description = "Optional input for the XL Path component which specifies the target Workbook and Sheet. If blank the active workbook and worksheet is used, or the worksheet index supplied by an origin component"
    Component.Params.Input(1).Name = "Data Origin"
    Component.Params.Input(1).Description = "Optional point list input which specifies the lower bounds to which data will be written where X = Row, Y = Column, and Z = Sheet Index. If Z = 0 the active sheet will be used. If input is empty cell A1 will be used"
    Component.Params.Input(2).Name = "Data"
    Component.Params.Input(2).Description = "Input for generic data which will be converted into number or text. The first branch of the tree specifies the column location relative to the origin and the list the row location. The second branch specifies the provided sheet index if more than one sheet has been specified from the origin"
    Component.Params.Input(3).Name = "By Column"
    Component.Params.Input(3).Description = "Sets if data will be transposed"
    Component.Params.Input(4).Name = "XL Fill"
    Component.Params.Input(4).Description = "Input for the XL Fill component which will specify the cell's background fill formatting"
    Component.Params.Input(5).Name = "XL Line"
    Component.Params.Input(5).Description = "Input for the XL Line component which will specify the cell's border formatting"
    Component.Params.Input(6).Name = "XL Font"
    Component.Params.Input(6).Description = "Input for the XL Font component which will specify the cell's font formatting"
    Component.Params.Input(7).Name = "Stream"
    Component.Params.Input(7).Description = "If true, data will be written"

    Component.Params.Output(1).Name = "Origin"
    Component.Params.Output(1).Description = "List output of points which specify the lower bounds of written data"
    Component.Params.Output(2).Name = "Bound"
    Component.Params.Output(2).Description = "List output of points which specify the upper bounds of written data"

    If _Stream = True Then

      If data.BranchCount() > 0 Then

        Dim objExcel, excelWorkbook, excelSheet As Object
        Data.SimplifyPaths()

        If XL_Path.Count() > 1 Then
          objExcel = XL_Path.item(0)
          excelWorkbook = XL_Path.item(1)
          excelSheet = XL_Path.item(2)
        Else
          Dim oldCI As System.Globalization.CultureInfo = system.Threading.Thread.CurrentThread.CurrentCulture
          System.Threading.Thread.CurrentThread.CurrentCulture = New System.Globalization.CultureInfo("en-US")

          'Access Active Session of Excel if no Path is specified
          objExcel = System.Runtime.InteropServices.Marshal.GetActiveObject("Excel.Application")
          excelWorkbook = objExcel.activeWorkbook
          excelSheet = objExcel.ActiveSheet
        End If
        objExcel.screenUpdating = False
        '#############################################

        ' Begin Formatting and Populating Data
        Dim i,j,k,m,n,p,u,v,r,s As Integer
        Dim x,y As Integer
        Dim cnt As New list(Of Integer)
        Dim ptA, ptB As New list(Of point3d)
        Dim sTree,pTree,lTree,fTree As New list(Of datatree(Of Object))
        Dim blnP,blnL,blnF As Boolean

        sTree = remapTree(Data)
        pTree = remapTree(XL_Fill)
        lTree = remapTree(XL_Line)
        fTree = remapTree(XL_Font)

        If Origin.count() = 0 Then
          Origin.add(New point3d(excelSheet.usedrange.row, excelSheet.usedrange.column, 0))
        End If

        For j = 0 To Origin.count() - 1 Step 1
          If j > (sTree.count() - 1) Then k = (sTree.count() - 1) Else k = j
          If CInt(origin.item(j).Z) > excelWorkbook.Sheets.Count() Then
            excelWorkbook.Sheets.add(, excelWorkbook.Sheets(excelWorkbook.Sheets.Count()), CInt(origin.item(j).Z - excelWorkbook.Sheets.Count()))
          End If
          If CInt(origin.item(j).Z) <> 0 Then excelSheet = excelWorkbook.Sheets.item(CInt(origin.item(j).Z))
          'finds the longest list of data to set the outer extent of the range
          For i = 0 To sTree.item(k).BranchCount() - 1 Step 1
            cnt.add(sTree.item(k).branch(i).count())
          Next
          Dim counts As Integer()
          counts = cnt.toarray
          Array.Sort(counts)
          Array.reverse(counts)

          If byColumn = True Then
            x = Origin.item(j).Y + counts(0) - 1
            y = Origin.item(j).X + sTree.item(k).BranchCount() - 1
          Else
            x = Origin.item(j).Y + sTree.item(k).BranchCount() - 1
            y = Origin.item(j).X + counts(0) - 1
          End If
          Dim rng As Object

          'specify a range in excel and stream data
          rng = excelSheet.Range(excelSheet.Cells(Origin.item(j).Y, Origin.item(j).X), excelSheet.Cells(x, y))

          If byColumn = True Then
            rng.value = objExcel.transpose(TreeToArr(sTree.item(k)))
          Else
            rng.value = TreeToArr(sTree.item(k))
          End If

          'Set the fill formatting
          If XL_Fill.branchcount() > 0 Then
            blnP = True
            If (XL_Fill.branchcount() = 1 And XL_Fill.branch(0).count() = 1) Then
              Call FillFormat(rng, pTree.item(0).branch(0).item(0))
              blnP = False
            End If
          End If

          'Set the fill formatting
          If XL_Line.branchcount() > 0 Then
            blnL = True
            If (XL_Line.branchcount() = 1 And XL_Line.branch(0).count() = 1) And (CBool(Split(XL_Line.branch(0).item(0), "~")(5).trim()) = False) Then
              Call LineFormat(rng, lTree.item(0).branch(0).item(0))
              blnL = False
            End If
          End If

          'Set the font formatting
          If XL_Font.branchcount() > 0 Then
            blnF = True
            If (XL_Font.branchcount() = 1 And XL_Font.branch(0).count() = 1) Then
              Call FontFormat(rng, fTree.item(0).branch(0).item(0))
              blnF = False
            End If
          End If

          For m = 0 To sTree.item(k).branchcount() - 1 Step 1
            For n = 0 To sTree.item(k).branch(m).count() - 1 Step 1
              If byColumn Then
                r = n
                s = m
              Else
                r = m
                s = n
              End If

              If blnP Then
                If j > pTree.count() - 1 Then p = pTree.count() - 1 Else p = j
                If m > pTree.item(p).branchcount() - 1 Then u = pTree.item(p).branchcount() - 1 Else u = m
                If n > pTree.item(p).branch(u).count() - 1 Then v = pTree.item(p).branch(u).count() - 1 Else v = n
                Call FillFormat(excelSheet.Cells(CInt(Origin.item(j).Y + r), CInt(Origin.item(j).X + s)), CStr(pTree.item(p).branch(u).item(v)))
              End If

              If blnL Then
                If j > lTree.count() - 1 Then p = lTree.count() - 1 Else p = j
                If m > lTree.item(p).branchcount() - 1 Then u = lTree.item(p).branchcount() - 1 Else u = m
                If n > lTree.item(p).branch(u).count() - 1 Then v = lTree.item(p).branch(u).count() - 1 Else v = n
                Call LineFormat(excelSheet.Cells(CInt(Origin.item(j).Y + r), CInt(Origin.item(j).X + s)), CStr(lTree.item(p).branch(u).item(v)))
              End If

              If blnF Then
                If j > fTree.count() - 1 Then p = fTree.count() - 1 Else p = j
                If m > fTree.item(p).branchcount() - 1 Then u = fTree.item(p).branchcount() - 1 Else u = m
                If n > fTree.item(p).branch(u).count() - 1 Then v = fTree.item(p).branch(u).count() - 1 Else v = n
                Call FontFormat(excelSheet.Cells(CInt(Origin.item(j).Y + r), CInt(Origin.item(j).X + s)), CStr(fTree.item(p).branch(u).item(v)))
              End If
            Next
          Next


          'Component Output is the origin cell and bounding cell location
          ptA.add(New Point3d(origin.item(j).X, origin.item(j).Y, excelSheet.Index))
          ptB.add(New Point3d(y, x, excelSheet.Index))
        Next
        excelSheet.activate
        objExcel.screenUpdating = True

        A = ptA
        B = ptB
      End If
    End If
# ---------- xl_data_out: VB additional code ----------
  'Cell Fill format
  Private Function FillFormat(ByVal obj As Object, ByVal strOptions As String)
    Dim arrOpt() As String = Split(strOptions, "~")
    Dim clrB() As String = Split(arrOpt(2), ",")
    Dim clrF() As String = Split(arrOpt(1), ",")
    With obj
      .Interior.Pattern = CInt(arrOpt(0))
      .Interior.Patterncolor = RGB(CInt(clrF(0).trim()), CInt(clrF(1).trim()), CInt(clrF(2).trim()))
      .Interior.color = RGB(CInt(clrB(0).trim()), CInt(clrB(1).trim()), CInt(clrB(2).trim()))

    End With
    Return Nothing
  End Function

  'Cell Line format
  Private Function LineFormat(ByVal obj As Object, ByVal strOptions As String)
    Dim arrOpt() As String = Split(strOptions, "~")
    Dim clrF() As String = Split(arrOpt(2), ",")
    With obj
      .BorderAround(CInt(arrOpt(0)), CInt(arrOpt(1)),, RGB(CInt(clrF(0).trim()), CInt(clrF(1).trim()), CInt(clrF(2).trim())))
    End With
    Return Nothing
  End Function

  'Sets font properties
  Private Function FontFormat(ByVal obj As Object, ByVal strOptions As String)
    Dim arrOpt() As String = Split(strOptions, "~")
    Dim clrF() As String = Split(arrOpt(1), ",")
    With obj
      .Font.Name = CStr(arrOpt(8).trim())
      .Font.Size = CInt(arrOpt(0).trim())
      .Font.Color = RGB(CInt(clrF(0).trim()), CInt(clrF(1).trim()), CInt(clrF(2).trim()))
      .HorizontalAlignment = CInt(arrOpt(2).trim())
      .VerticalAlignment = CInt(arrOpt(3).trim())
      .Font.Bold = CBool(arrOpt(4).trim())
      .Font.Italic = CBool(arrOpt(5).trim())
      .Font.Underline = CBool(arrOpt(6).trim())
      .Font.Strikethrough = CBool(arrOpt(7).trim())
    End With
    Return Nothing
  End Function

  Private Function TreeToArr(ByVal arrTree As Datatree(Of Object))

    Dim i,j,x,y As Integer

    y = 0
    x = arrTree.branchCount() - 1
    For i = 0 To x Step 1
      If y < (arrTree.branch(i).count() - 1)
        y = arrTree.branch(i).count() - 1
      End If
    Next

    Dim arrOut(x,y) As Object

    For i = 0 To x Step 1
      For j = 0 To y Step 1
        If j > (arrTree.branch(i).count() - 1) Then
          arrOut(i, j) = Nothing
        Else
          arrOut(i, j) = arrTree.branch(i).item(j)
        End If
      Next
    Next

    Return arrOut
  End Function
  Function remapTree(ByVal arrTree As datatree(Of Object))
    If arrTree.branchcount() > 0 Then
      Dim i,j,k,m,r,s As Integer
      Dim uTree,tTree As New datatree(Of Object)
      Dim sTree As New list(Of datatree(Of Object))

      If uBound(arrTree.Paths.item(0).indices()) > 1 Then
        For i = 0 To arrTree.branchcount() - 1 Step 1
          Dim tPath As gh_path
          Dim tint() As int32
          tPath = arrTree.Paths.item(i)
          tint = tPath.Indices

          If uBound(tint) > 0 Then
            For j = 0 To arrTree.Branch(i).Count() - 1 Step 1
              uTree.add(arrTree.Branch(i).item(j), New gh_path({tint(uBound(tint) - 1),tint(uBound(tint))}))
            Next
          Else
            For j = 0 To arrTree.Branch(i).Count() - 1 Step 1
              uTree.add(arrTree.Branch(i).item(j), New gh_path({0,i}))
            Next
          End If
        Next
      Else
        uTree = arrTree
      End If

      If uBound(uTree.Paths.item(0).indices()) > 0 Then
        k = uTree.Paths.item(0).indices(uBound(uTree.Paths.item(0).indices()) - 1)
        For i = 0 To uTree.branchcount() - 1 Step 1
          Dim tPath As gh_path
          Dim tint() As int32
          tPath = uTree.Paths.item(i)
          tint = tPath.Indices

          If tint(uBound(tint) - 1) > k Then
            Dim tmpTree As New datatree(Of Object)
            For r = 0 To tTree.branchcount() - 1 Step 1
              For s = 0 To tTree.branch(r).count() - 1 Step 1
                tmpTree.add(tTree.branch(r).item(s), New gh_path(r))
              Next
            Next
            sTree.add(tmpTree)
            tTree.clear
            k = tint(uBound(tint) - 1)
            m = 0
          End If
          For j = 0 To uTree.Branch(i).Count() - 1 Step 1
            tTree.add(uTree.Branch(i).item(j), New gh_path(m))
          Next
          m += 1
        Next

        sTree.add(tTree)
      Else
        sTree.add(uTree)
      End If
      Return sTree
    Else
      Return Nothing
    End If
  End Function
  Function flipMatrix(ByVal arrVal As datatree(Of Object))
    Dim objOut As New DataTree(Of Object)
    Dim source As New GH_Lexer("{A}(B)")
    Dim target As New GH_Lexer("{B}(A)")

    GH_Lexer.PerformLexicalReplace(source, target, arrVal, objOut)

    Return objOut
  End Function
  Function lexGraft(ByVal arrVal As datatree(Of Object))
    Dim objOut As New DataTree(Of Object)
    Dim source As New GH_Lexer("{A}(i)")
    Dim target As New GH_Lexer("{A;0}(i)")

    GH_Lexer.PerformLexicalReplace(source, target, arrVal, objOut)

    Return objOut
  End Function
# ---------- end xl_data_out ----------

# ----
ma = MassAddition(Input=rev_4)  # -> Result, PartialResults
division_2 = Division(A=rev_4, B=ma.Result)
multiplication_3 = Multiplication(A=division_2, B=100)
split_6 = SplitList(List=multiplication_3, Index=values_4.Values)  # -> ListA, ListB
sort_3 = SortList(Keys=python_4.wbcount, ValuesA=split_2.ListB)  # -> Keys, ValuesA
sort_4 = SortList(Keys=python_4.wacount, ValuesA=split_2.ListB)  # -> Keys, ValuesA
number_slider_2 = Slider(25, range=10..50)
panel_6 = Panel(split.ListB)
panel_7 = Panel("""word
word""")
tag = TextTag3D(Location=xy, Text=split_2.ListB, Size=split_4.ListB, Justification=7)
panel_8 = Panel("""number
number""")
data_2 = Data(flatten(split.ListA))
chart = CreateChart(Data="1", Names="base", Title="Category Relevance", SubTitle="Percentage", ChartType=2)
rev_5 = ReverseList(List=sort_3.Keys)
rev_6 = ReverseList(List=sort_3.ValuesA)
rev_7 = ReverseList(List=sort_4.Keys)
rev_8 = ReverseList(List=sort_4.ValuesA)
split_7 = SplitList(List=rev_3, Index=values_4.Values)  # -> ListA, ListB
int = Integer(split_6.ListA)
listbox = CreateListBox(ListItems="Word", SelectedIndex=0, Height=number_slider_2)
listbox_2 = CreateListBox(ListItems="Occurence", SelectedIndex=0, Height=number_slider_2)
listbox_3 = CreateListBox(ListItems=flatten(panel_5), SelectedIndex=0, Height=100)
split_8 = SplitList(List=rev_5, Index=values_3.Values)  # -> ListA, ListB
split_9 = SplitList(List=rev_6, Index=values_3.Values)  # -> ListA, ListB
listbox_4 = CreateListBox(ListItems=panel_7, SelectedIndex=0, Height=number_slider)
split_10 = SplitList(List=rev_7, Index=values_3.Values)  # -> ListA, ListB
split_11 = SplitList(List=rev_8, Index=values_3.Values)  # -> ListA, ListB
listbox_5 = CreateListBox(ListItems=panel_8, SelectedIndex=0, Height=number_slider)
listbox_6 = CreateListBox(ListItems="appears", SelectedIndex=0, Height=number_slider)
listbox_7 = CreateListBox(ListItems="times", SelectedIndex=0, Height=number_slider)
stack = CreateStack(UIElements=[listbox, listbox_2], Horizontal=True)
combined_associated_words = Merge(Data1=split_9.ListA, Data2=split_11.ListA)
combined_frequency = Merge(Data1=split_8.ListA, Data2=split_10.ListA)
panel_9 = Panel("""Setup
Statistics
Checks""")
stack_2 = CreateStack(UIElements=[listbox_4, listbox_5], Horizontal=True)
entwine_3 = Entwine(
    Branch00=chart,
    Branch01=slider_2,
    Branch02=label,
    Branch03=tb_4,
    Branch04=tb_5,
    Branch05=tb_7,
    Branch06=tb_15,
    Branch07=tb_6,
    Branch08=tb_3,
    Branch09=tb_8,
    Branch010=tb_9,
    Branch011=tb_12,
    Branch012=tb_16,
    Branch013=tb_17,
    Branch014=tb_10,
    Branch015=tb_11,
    Branch016=tb_13,
    Branch017=tb_14,
    Branch018=slider,
    Branch019=stack_2,
    FlattenInputs=True)
chartappearance = ChartAppearance(ChartToModify=chart, Legend=Toggle(True))
setchart = SetChartContents(ChartToModify=chart, NewChartValues=int, NewChartNames=split_7.ListA)
adjustpos = AdjustElementPositioning(ElementsToAdjust=stack, AbsolutePositioning=False, HorizontalAlignment=1)
adjustpos_2 = AdjustElementPositioning(ElementsToAdjust=stack_2, AbsolutePositioning=False, HorizontalAlignment=1)
entwine_4 = Entwine(Branch00=chart, Branch01=slider_2, Branch02=label, Branch03=slider, Branch04=stack, Branch05=stack_2, FlattenInputs=True)
panel_10 = Panel(split_8.ListA)
panel_11 = Panel(split_9.ListA)
check_random_text = Slider(5, range=1..20)
pulldown = CreatePulldownMenu(ListItems=flatten)
panel_12 = Panel(graft_3)
int_2 = Integer(panel_12)
setlist = SetListContents(ListToModify=listbox_5, NewListContents=flatten(int_2))
setlist_2 = SetListContents(ListToModify=listbox_6, NewListContents=flatten(int_2))
setlist_3 = SetListContents(ListToModify=listbox_7, NewListContents=flatten(int_2))
slider_3 = CreateSlider(Slider=check_random_text, ShowBounds=False, ShowTicks=False, ShowTooltip=False, ShowValLabel=True)
top_10_words = Panel(graft_2)
settextbox = SetTextBoxContents(TextBoxToModify=textbox, NewTextBoxContents=top_10_words)
settextblock = SetTextBlockContents(TextBlockToModify=tb_2, NewTextBlockContents=flatten(top_10_words))
concat_2 = Concatenate(FragmentE="\"", FragmentA=top_10_words, FragmentB="\" appears ", FragmentC=int_2, FragmentD=" times")
bang = ExplodeTree(Data=concat_2)  # -> _0000, _0001, _0002, _0003, _0004, _0005, _0006, Branch7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
python_5 = PythonScript(
    one=bang._0000,
    two=bang._0001,
    three=bang._0002,
    four=bang._0003,
    five=bang._0004,
    six=bang._0005,
    seven=bang._0006,
    eight=bang.Branch7,
    nine=bang.Branch8,
    ten=bang.Branch9,
    eleven=bang.Branch10,
    twelve=bang.Branch11,
    thirteen=bang.Branch12,
    fourteen=bang.Branch13,
    fifteen=bang.Branch14)  # -> out, a, b, c, d, e, f, g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
# ---------- python_5: Python ----------
print x

if one == None:
    a = " "
else:
    a = one

if two == None:
    b = " "
else:
    b = two

if three == None:
    c = " "
else:
    c = three

if four == None:
    d = " "
else:
    d = four

if five == None:
    e = " "
else:
    e = five

if six == None:
    f = " "
else:
    f = six

if seven == None:
    g = " "
else:
    g = seven

if eight == None:
    h = " "
else:
    h = eight

if nine == None:
    i = " "
else:
    i = nine

if ten == None:
    j = " "
else:
    j = ten

if eleven == None:
    k = " "
else:
    k = eleven

if twelve == None:
    l = " "
else:
    l = twelve

if thirteen == None:
    m = " "
else:
    m = thirteen

if fourteen == None:
    n = " "
else:
    n = fourteen

if fifteen == None:
    aa = " "
else:
    aa = fifteen
# ---------- end python_5 ----------
flatten_3 = FlattenTree(Tree=concat_2, Path="{0}")
panel_13 = Panel(flatten_3)
settextblock_2 = SetTextBlockContents(TextBlockToModify=tb_3, NewTextBlockContents=python_5.f)
settextblock_3 = SetTextBlockContents(TextBlockToModify=tb_4, NewTextBlockContents=python_5.a)
settextblock_4 = SetTextBlockContents(TextBlockToModify=tb_5, NewTextBlockContents=python_5.b)
settextblock_5 = SetTextBlockContents(TextBlockToModify=tb_6, NewTextBlockContents=python_5.e)
settextblock_6 = SetTextBlockContents(TextBlockToModify=tb_7, NewTextBlockContents=python_5.c)
settextblock_7 = SetTextBlockContents(TextBlockToModify=tb_8, NewTextBlockContents=python_5.g)
settextblock_8 = SetTextBlockContents(TextBlockToModify=tb_9, NewTextBlockContents=python_5.h)
settextblock_9 = SetTextBlockContents(TextBlockToModify=tb_10, NewTextBlockContents=python_5.l)
settextblock_10 = SetTextBlockContents(TextBlockToModify=tb_11, NewTextBlockContents=python_5.m)
settextblock_11 = SetTextBlockContents(TextBlockToModify=tb_12, NewTextBlockContents=python_5.i)
settextblock_12 = SetTextBlockContents(TextBlockToModify=tb_13, NewTextBlockContents=python_5.n)
settextblock_13 = SetTextBlockContents(TextBlockToModify=tb_14, NewTextBlockContents=python_5.aa)
settextblock_14 = SetTextBlockContents(TextBlockToModify=tb_15, NewTextBlockContents=python_5.d)
settextblock_15 = SetTextBlockContents(TextBlockToModify=tb_16, NewTextBlockContents=python_5.j)
settextblock_16 = SetTextBlockContents(TextBlockToModify=tb_17, NewTextBlockContents=python_5.k)
flatten_4 = FlattenTree(Tree=top_10_words, Path="{0}")
setlist_4 = SetListContents(ListToModify=listbox_4, NewListContents=flatten_4)
values_5 = ValueListener(Elements=pulldown, SomeProperty=True)  # -> Values, Indices
tmatch = MatchText(Text=values_5.Values, Pattern=data_2, Case=True)
python_6 = PythonScript(topics=tmatch)  # -> out, path, path2; inputs topics: list
# ---------- python_6: Python ----------
for index, topic in enumerate(topics):
    if topic == True:
        path = "{0;"+str(index)+"}"
        path2 = "{"+str(index)+";0}"
# ---------- end python_6 ----------
branch = TreeBranch(Tree=panel_6, Path=python_6.path2, MaintainPaths=True)
null = NullItem(Item=branch)  # -> NullFlags, InvalidFlags, Description
branch_2 = TreeBranch(Tree=count_elements_from_one_list_in_another.Word_found, Path=python_6.path, MaintainPaths=True)
branch_3 = TreeBranch(Tree=count_elements_from_one_list_in_another.paths, Path=python_6.path, MaintainPaths=True)
cull = CullPattern(List=branch, CullPattern=null.NullFlags)
branch_4 = TreeBranch(Tree=graft, Path=branch_3, MaintainPaths=True)
setlist_5 = SetListContents(ListToModify=listbox_3, NewListContents=branch)
panel_14 = Panel(branch_2)
panel_15 = Panel(cull)
panel_16 = Panel(branch_4)
join = TextJoin(Text=panel_16, Join=" ")
path_mapper = PathMapper(join, source="{A;B;C;D;E}", target="{path_index}")
viewer = ParamViewer(path_mapper)
values_6 = ValueListener(Elements=slider_3, SomeProperty=True)  # -> Values, Indices

# ---- group: Main circle
lng_3 = ListLength(List=split_5.ListA)
subtraction = Subtraction(A=lng_3, B=1)
merge = Merge(Data1="0", Data2=subtraction)  # -> flatten(Result)
item_3 = ListItem(List=split_5.ListA, Index=merge, Wrap=True)
split_12 = SplitList(List=item_3, Index=1)  # -> ListA, ListB
pop2d = Populate2D(Region={Plane=PlaneXY(-277, -880, 0), Size=Domain2(u=0..1916, v=0..1589)}, Count=values_3.Values, Seed=1)
graft_4 = GraftTree(Tree=pop2d, IncludeEmptyLists=True, IncludeNullItems=True)
gradient = Gradient(
    LowerLimit=split_12.ListB,
    UpperLimit=split_12.ListA,
    Parameter=graft_3,
    stops=[0: RGB(255, 0, 0), 0.5: RGB(255, 255, 0), 1: RGB(0, 128, 0)])
circle = CircleCNR(Center=graft_4, Normal=Vector(0, 0, 1), Radius=graft_3)
boundary = BoundarySurfaces(Edges=circle)
preview = CustomPreview(Geometry=boundary, Shader=gradient)

# ----
panel_17 = Panel(split_11.ListA)
label_2 = CreateLabel(LabelText="Topic Dictionary", LabelSize=18, Justification=0)
label_3 = CreateLabel(LabelText="Topic related text finder", LabelSize=18, Justification=0)
tb_18 = CreateTextBlock(Text="Text", TextSize=12, Justification=0)
label_4 = CreateLabel(LabelText="Text", LabelSize=12, Justification=1)
lng_4 = ListLength(List=viewer)
panel_18 = Panel(path_mapper)
panel_19 = Panel(split_10.ListA)
entwine_5 = Entwine(
    Branch00=pulldown,
    Branch01=label_2,
    Branch02=listbox_3,
    Branch03=label_3,
    Branch04=slider_3,
    Branch05=label_4,
    Branch06=tb_18,
    FlattenInputs=True)
tabs = TabbedView(TabNames=panel_9, Tab0=flatten(entwine), Tab1=flatten(entwine_4), Tab2=flatten(entwine_5))
addelems = AddElements(Window=launchwin, Elements=flatten(tabs))  # -> AddedElements, ElementNames
branch_5 = TreeBranch(Tree=panel_18, Path=values_6.Values, MaintainPaths=True)
settextblock_17 = SetTextBlockContents(TextBlockToModify=tb_18, NewTextBlockContents=branch_5)

size_of_main_text = Slider(3, range=1..3)
size_of_small_circles = Slider(7, range=1..10)
size_of_small_text = Slider(3, range=0..3)

# ---- group: Main text
division_3 = Division(A=graft_3, B=size_of_main_text)
xy_2 = XYPlane(Origin=graft_4)
tag_2 = TextTag3D(Location=xy_2, Text=graft_2, Size=division_3, Colour=ColourSwatch(SwatchColor=RGB(0, 0, 0)), Justification=5)

# ---- group: Lines between circles
multiplication_4 = Multiplication(A=values_3.Values, B=2)
divide = DivideCurve(Curve=circle, Count=multiplication_4, Kinks=False)  # -> Points, Tangents, Parameters
ln = Line(StartPoint=graft_4, EndPoint=divide.Points)
multiplication_5 = Multiplication(A=graft_3, B=-1)
multiplication_6 = Multiplication(A=combined_frequency, B=20)
ext = ExtendCurve(Curve=ln, Type=0, Start=multiplication_5, End=multiplication_6)
end = EndPoints(Curve=ext)  # -> Start, End

# ---- group: Small text
multiplication_7 = Multiplication(A=combined_frequency, B=size_of_small_text)
xy_3 = XYPlane(Origin=end.End)
tag_3 = TextTag3D(
    Location=xy_3,
    Text=combined_associated_words,
    Size=multiplication_7,
    Colour=ColourSwatch(SwatchColor=RGB(0, 0, 0)),
    Justification=5)

# ---- group: Small circles
lng_5 = ListLength(List=flatten(combined_frequency))
sort_5 = SortList(Keys=flatten(combined_frequency))  # -> Keys, ValuesA
subtraction_2 = Subtraction(A=lng_5, B=1)
multiplication_8 = Multiplication(A=combined_frequency, B=size_of_small_circles)
merge_2 = Merge(Data1="0", Data2=subtraction_2)  # -> flatten(Result)
rev_9 = ReverseList(List=sort_5.Keys)
circle_2 = CircleCNR(Center=end.End, Normal=Vector(0, 0, 1), Radius=multiplication_8)
item_4 = ListItem(List=rev_9, Index=merge_2, Wrap=True)
split_13 = SplitList(List=item_4, Index=1)  # -> ListA, ListB
boundary_2 = BoundarySurfaces(Edges=circle_2)
gradient_2 = Gradient(
    LowerLimit=split_13.ListB,
    UpperLimit=split_13.ListA,
    Parameter=combined_frequency,
    stops=[0: RGB(255, 0, 0), 0.456: RGB(255, 255, 0), 1: RGB(0, 128, 0)])
preview_2 = CustomPreview(Geometry=boundary_2, Shader=gradient_2)

# ---- group: Lines between circles (continued)
crvprox = CurveProximity(CurveA=ext, CurveB=circle_2)  # -> PointA, PointB, Distance
ln_2 = Line(StartPoint=end.Start, EndPoint=crvprox.PointA)
